# Grasshopper definition geometrylisttest.ghx (Grasshopper 0.9.65)

L = List()
dispatch = Dispatch(List=L, DispatchPattern=[True, False])  # -> ListA, ListB
short = ShortestList(ListA=dispatch.ListA, ListB=dispatch.ListB, TrimMode=2)  # -> ListA, ListB
ln = Line(StartPoint=short.ListA, EndPoint=short.ListB)
len = Length(Curve=ln)
division = Division(A=len, B="3")
sph = Sphere(Base=short.ListB, Radius=division)
geo = Geometry(sph)
geo_2 = Geometry(geo)
