# Grasshopper definition hairworm_basic_example.ghx (Grasshopper 0.9.65)
# plug-ins: Hairworm

# https://github.com/provolot/GrasshopperExchange/raw/master/Hairworm/_example_files/SphereMaker.ghcluster
panel = Panel("https://github.com/provolot/GrasshopperExchange/raw/master/Hairworm/_example_files/TypedParamTest.ghx")
# https://raw.github.com/provolot/GrasshopperExchange/master/Hairworm/_example_files/BoxSphereMakerVariableghx.ghx
# https://github.com/provolot/GrasshopperExchange/raw/master/Hairworm/_example_files/NestedSpheres.ghx
panel_2 = Panel("https://github.com/provolot/GrasshopperExchange/raw/master/Hairworm/_example_files/HexagridOnSrf.ghx")
# https://github.com/provolot/GrasshopperExchange/raw/master/Hairworm/_example_files\RandomSphereMaker.ghx
panel_3 = Panel("https://github.com/provolot/GrasshopperExchange/raw/master/Hairworm/_example_files\WormholeMaker.ghx")
number_slider = Slider(33, range=0..100)
panel_4 = Panel("3")
number_slider_2 = Slider(7, range=0..10)
number_slider_3 = Slider(10, range=0..10)
geo = Geometry(<brep referenced from the Rhino model>)
hairworm_hexagridonsrf = HairwormHexagridOnSrf(ClusterURL=panel_2, S=geo, Ex=number_slider_2, Ey=number_slider_2)  # -> Debug, Output, C, P
hairworm_typedparamtest = HairwormTypedParamTest(ClusterURL=panel)  # -> Debug, Geometry, Number
geo_2 = Geometry(hairworm_hexagridonsrf.P)
geo_3 = Geometry(flatten(geo_2))
jitter = Jitter(List=geo_3, Jitter=1, Seed=2)  # -> Values, Indices
dispatch = Dispatch(List=jitter.Values, DispatchPattern=[True, False])  # -> ListA, ListB
short = ShortestList(ListA=dispatch.ListA, ListB=dispatch.ListB, TrimMode=2)  # -> ListA, ListB
hairworm_wormholemaker = HairwormWormholeMaker(ClusterURL=panel_3, Point=short.ListA, Point_2=short.ListB, Number=Slider(9, range=0..10))  # -> Debug, Geometry
colour = ColourPicker(PickedColour=RGB(242, 239, 31))
geo_4 = Geometry(hairworm_wormholemaker.Geometry)
preview = CustomPreview(Geometry=geo_4, Shader=colour)
